vi "Main.gviweb"   [LabVIEW NXG 2.0.0]
panel controls:
  "Trigger Send": bool
  "Trigger Reset": bool
panel indicators:
  "Send File": bool
  "Reset": bool
  "Disk Usage": f64
  "Memory Usage": f64
  "Files Sent": i32
  "Buffer": i32
  "Chart": T1
types:
  T1 = cluster{"Element 1": f64, "Element 2": f64, "Element 3": f64, "Element 4": f64}
uses:
  NI::Skyline::Configuration::Open Configuration.gvi
  NI::Skyline::MessageHTTP::Open.gvi
  NI::Skyline::MessageHTTP::Publish.gvi
  NI::Skyline::MessageHTTP::Close.gvi
  NI::Skyline::TagHTTP::Open Tag.gvi
  NI::Skyline::TagHTTP::Reset Aggregates (Single).gvi
  NI::Skyline::TagHTTP::Close Tag (Single).gvi
  NI::Skyline::TagHTTP::Read Tag (DBL).gvi
  NI::Skyline::TagHTTP::Read Tag (I32).gvi
diagram:
  w1 = "cRIO-9068--SN-190CB7B--MAC-00-80-2F-15-AC-43"  # Target
  w2 = "demo.systemlink.io"  # Server
  call "Open Configuration.gvi"(server url=w2, username="admin", password="labview===") -> (configuration=w3)
  while {
    Wait(time to wait=50)
    case ($"Trigger Send") {
      frame False, Default {
        $"Send File" <- FALSE
      }
      frame True {
        Wait(time to wait=500)
        $"Send File" <- TRUE
        call "Open.gvi"(configuration=w3) -> (message session out=w4)
        call "Publish.gvi"(message session=w4, topic="send_file", message="send_file") -> (message session out=w5)
        call "Close.gvi"(message session=w5)
      }
    }
    case ($"Trigger Reset") {
      frame False, Default {
        $Reset <- FALSE
      }
      frame True {
        $Reset <- TRUE
        Concatenate Strings(w1, ".cRIO_Temp_Monitor.ai.", "0") -> w6
        call "Open Tag.gvi"(path=w6, data type="Double", configuration=w3) -> (tag out=w7, error out=w8)
        call "Reset Aggregates (Single).gvi"(tag in=w7, error in=w8) -> (tag out=w9, error out=w10)
        call "Close Tag (Single).gvi"(tag=w9, error in=w10)
        Wait(time to wait=500)
      }
    }
    stop if FALSE
  }
  while {
    Wait(time to wait=1000)
    w11 = ["Health.Disk.Used", "Health.Memory.Used", "cRIO_Temp_Monitor.files_sent", "cRIO_Temp_Monitor.buffer", "cRIO_Temp_Monitor.ai.0"]
    for (iteration -> i1) {
      w12 = each element of w11
      Concatenate Strings(w1, ".", w12) -> w13
      case (i1) {
        frame 0, Default {
          call "Open Tag.gvi"(path=w13, data type="Double", configuration=w3) -> (tag out=w14, error out=w15)
          call "Read Tag (DBL).gvi"(tag in=w14, error in=w15) -> (tag out=w16, value=w17, error out=w18)
          call "Close Tag (Single).gvi"(tag=w16, error in=w18)
          $"Disk Usage" <- w17
        }
        frame 1 {
          call "Open Tag.gvi"(path=w13, data type="Double", configuration=w3) -> (tag out=w19, error out=w20)
          call "Read Tag (DBL).gvi"(tag in=w19, error in=w20) -> (tag out=w21, value=w22, error out=w23)
          call "Close Tag (Single).gvi"(tag=w21, error in=w23)
          $"Memory Usage" <- w22
        }
        frame 2 {
          call "Open Tag.gvi"(path=w13, data type="Integer", configuration=w3) -> (tag out=w24, error out=w25)
          call "Read Tag (I32).gvi"(tag in=w24, error in=w25) -> (tag out=w26, value=w27, error out=w28)
          call "Close Tag (Single).gvi"(tag=w26, error in=w28)
          $"Files Sent" <- w27
        }
        frame 3 {
          call "Open Tag.gvi"(path=w13, data type="Integer", configuration=w3) -> (tag out=w29, error out=w30)
          call "Read Tag (I32).gvi"(tag in=w29, error in=w30) -> (tag out=w31, value=w32, error out=w33)
          call "Close Tag (Single).gvi"(tag=w31, error in=w33)
          $Buffer <- w32
        }
        frame 4 {
          call "Open Tag.gvi"(path=w13, data type="Double", configuration=w3) -> (tag out=w34, error out=w35)
          call "Read Tag (DBL).gvi"(tag in=w34, error in=w35) -> (tag out=w36, value=w37, error out=w38, aggregates=w39)
          Property Node(instance in=w39) -> ("Max"=w40, "Mean"=w41, "Min"=w42)
          Build Cluster(w37, w40, w41, w42) -> w43
          $Chart <- w43
          call "Close Tag (Single).gvi"(tag=w36, error in=w38)
        }
      }
    }
    stop if FALSE
  }
