vi "Read Tag (Double).gviweb"   [LabVIEW NXG 2.0.0]
inputs:
  "Server": string
  "Tag": string
outputs:
  "Value": f64
  "Minimum": f64
  "Average": f64
  "Maximum": f64
  "Count": i32
  "Timestamp": string
panel indicators:
  "Request": string
  "body": string
types:
  T1 = cluster{"timestamp": string, "value": cluster{"type": string, "value": string}}
  T2 = cluster{"count": i32, "avg": f64, "max": f64, "sum": f64, "min": f64}
uses:
  NI::HTTP::GET.gvi
diagram:
  Concatenate Strings("http://", $Server, "/nitag/v1/tags/", $Tag, "/values") -> w1
  $Request <- w1
  w2 = cluster{"current": T1, "aggregates": T2} {all zero or empty}  # Cluster Constant
  call "GET.gvi"(url=w1) -> (body=w3)
  Unflatten From JSON(JSON string=w3, type and defaults=w2) -> (value=w4)
  Property Node(instance in=w4) -> ("current:value:value"=w5, "current:timestamp"=w6, "aggregates:min"=w7, "aggregates:max"=w8, "aggregates:count"=w9, "aggregates:avg"=w10)
  Scan From String(formatString="%f", inputString=w5) -> (out0=w11)
  $Value <- w11
  $body <- w3
  $Timestamp <- w6
  $Minimum <- w7
  $Maximum <- w8
  $Count <- w9
  $Average <- w10
