vi "Update Tag (Double).gviweb"   [LabVIEW Platform Developer Preview 0.1.0]
inputs:
  "Server": string
  "Tag": string
  "Tag Value": f64
outputs:
  "URI": string
  "Body": string
  "Headers Out": string
panel controls:
  "Cluster Constant": T1
panel indicators:
  "Body Out": string
types:
  T1 = cluster{"Value": cluster{"Type": string, "Value": string}, "Timestamp": string}
uses:
  NI::HTTP::PUT Buffer.gvi
diagram:
  Format Into String(formatString="%f", $"Tag Value") -> w1
  Property Node(instance in=$"Cluster Constant", "Timestamp"="0001-01-01T00:00:00", "Value:Type"="Double", "Value:Value"=w1) -> (instance out=w2)
  Flatten To JSON(anything=w2) -> (JSON string=w3)
  $Body <- w3
  Concatenate Strings("http://", $Server, "/nitag/tag/", $Tag, "/timestamped_value") -> w4
  $URI <- w4
  call "PUT Buffer.gvi"(url=w4, buffer=w3) -> (headers=w5, body=w6)
  $"Headers Out" <- w5
  $"Body Out" <- w6
