vi "Function.gviweb"   [LabVIEW Platform Developer Preview 0.1.0]
panel controls:
  "Trigger Send": bool
  "Trigger Reset": bool
  "Channel": i32
panel indicators:
  "Send File": bool
  "Temp": T1
  "Buffer": f64
  "Files Sent": f64
  "Available Memory": f64
  "Available Disk": f64
  "Reset": bool
types:
  T1 = cluster{"Element 1": f64, "Element 2": f64, "Element 3": f64, "Element 4": f64}
uses:
  Application::Send Message.gviweb
  Application::Reset Aggregates.gviweb
  Application::Read Tag (Double).gviweb
diagram:
  w1 = "josh-9068"  # Target
  w2 = "jprewitt4"  # Server
  while {
    Wait(time to wait=50)
    case ($"Trigger Send") {
      frame False, Default {
        $"Send File" <- FALSE
      }
      frame True {
        Wait(time to wait=500)
        $"Send File" <- TRUE
        call "Send Message.gviweb"(Topic="send_file", Server=w2, Message="send_file")
      }
    }
    case ($"Trigger Reset") {
      frame False, Default {
        $Reset <- FALSE
      }
      frame True {
        $Reset <- TRUE
        Format Value(format string="%d", value=$Channel) -> (output string=w3)
        Concatenate Strings(w1, ".ai.", w3) -> w4
        call "Reset Aggregates.gviweb"(Server=w2, Tag=w4)
        Wait(time to wait=500)
      }
    }
    stop if FALSE
  }
  while {
    Wait(time to wait=1000)
    w5 = ["available_disk", "available_memory", "files_sent", "buffer", "ai"]
    for (iteration -> i1) {
      w6 = each element of w5
      Concatenate Strings(w1, ".", w6) -> w7
      case (i1) {
        frame 0, Default {
          call "Read Tag (Double).gviweb"(Server=w2, Tag=w7) -> (Value=w8)
          $"Available Disk" <- w8
        }
        frame 1 {
          call "Read Tag (Double).gviweb"(Server=w2, Tag=w7) -> (Value=w9)
          $"Available Memory" <- w9
        }
        frame 2 {
          call "Read Tag (Double).gviweb"(Server=w2, Tag=w7) -> (Value=w10)
          $"Files Sent" <- w10
        }
        frame 3 {
          call "Read Tag (Double).gviweb"(Server=w2, Tag=w7) -> (Value=w11)
          $Buffer <- w11
        }
        frame 4 {
          Format Value(format string="%d", value=$Channel) -> (output string=w12)
          Concatenate Strings(w7, ".", w12) -> w13
          call "Read Tag (Double).gviweb"(Server=w2, Tag=w13) -> (Value=w14, Minimum=w15, Average=w16, Maximum=w17)
          Build Cluster(w14, w15, w16, w17) -> w18
          $Temp <- w18
        }
      }
    }
    stop if FALSE
  }
