vi "Add Header.gvi"   [LabVIEW Platform Developer Preview 0.1.0]
# Adds a header field line to all Web requests associated with the client handle. Headers define attributes of the data exchanged between the client and server.
inputs:
  "header": "Headers.gtype" = "User-Agent", required
  "client handle": "Client Handle.gtype", required  # client handle specifies the client handle to associate with the Web request. Use client handles to wire together multiple HTTP Client VIs while preserving authentication credentials, HTTP headers, and cookies. Client handles are not required when making independent Web requests without persistent data such as headers or credentials.
  "value": string  # value specifies the value to assign to the header field.
  "error in": error
outputs:
  "client handle out": "Client Handle.gtype"  # client handle out returns the client handle associated with the Web request. Use client handles to wire together multiple HTTP Client VIs while preserving authentication credentials, HTTP headers, and cookies. Client handles are not required when making independent Web requests without persistent data such as headers or credentials.
  "error out": error
types:
  "Client Handle.gtype" = u32
  "Headers.gtype" = string
uses:
  NI::G Core::HTTP::httpWebServerClient.sli::httpWebServer_AddHeader
  NI::G Core::HTTP::httpClient.sli::http_AddHeader
  NI::G Core::Error::Build Error Cluster.gvi
diagram:
  # Add a header to the current request chain.
  case ($"error in") {
    frame No Error {
      disable {
        frame TARGET_TYPE == "WebServer" {
          call "httpWebServer_AddHeader"(handle in=$"client handle", headerName in=$header, headerValue in=$value, error in=$"error in") -> (handle out=w1, error out=w2)
        }
        frame 1, Default {
          call "http_AddHeader"(handle in=$"client handle", headerName=$header, headerValue=$value, error in=$"error in") -> (return=w3, handle out=w1, error out=w4)
          call "Build Error Cluster.gvi"(code=w3, error in=w4) -> (error out=w2)
        }
      }
    }
    frame Error {
      w1 = $"client handle"
      w2 = $"error in"
    }
  }
  $"client handle out" <- w1
  $"error out" <- w2
