vi "Check For Success.gvi"   [LabVIEW Platform Developer Preview 0.1.0]
inputs:
  "headers": string, required
  "error in": error
outputs:
  "success": bool
  "error out": error
panel indicators:
  "whole match": string
diagram:
  Match Regular Expression(inputString=$headers, regExpression="HTTP/1.1 2\\d{2}", errorIn=$"error in", ignoreCase=TRUE) -> (wholeMatch=w1, errorOut=w2)
  # Check to see if the status code is within the 200 range.
  $"whole match" <- w1
  Is Empty String Or Path(string/path=w1) -> w3
  Not(x=w3) -> w4
  $success <- w4
  $"error out" <- w2
