vi "Close HTTP Handle.gvi"   [LabVIEW Platform Developer Preview 0.1.0]
# Closes the client handle and deletes all stored cookies, authentication credentials, and HTTP headers associated with the client handle. This VI also terminates all HTTP connections and logs out of any authentication, if applicable.
inputs:
  "client handle": "Client Handle.gtype", required  # client handle specifies the client handle to associate with the Web request. Use client handles to wire together multiple HTTP Client VIs while preserving authentication credentials, HTTP headers, and cookies. Client handles are not required when making independent Web requests without persistent data such as headers or credentials.
  "error in": error
outputs:
  "error out": error
types:
  "Client Handle.gtype" = u32
uses:
  NI::G Core::HTTP::httpWebServerClient.sli::httpWebServer_Close
  NI::G Core::HTTP::httpClient.sli::http_Close
  NI::G Core::Error::Build Error Cluster.gvi
diagram:
  # Close the current request chain.
  disable {
    frame TARGET_TYPE == "WebServer" {
      call "httpWebServer_Close"(handle in=$"client handle", error in=$"error in") -> (error out=w1)
    }
    frame 1, Default {
      Generate Occurrence() -> (occurrence=w2)
      call "http_Close"(handle in=$"client handle", completeOccurrence in=w2, closed in=0) -> (return=w3, completeOccurrence out=w4, closed out=w5)
      Is Equal To 0(x=w5) -> w6
      call "Build Error Cluster.gvi"(code=w3) -> (error out=w7)
      case (w6) {
        frame False {
          w8 = default
        }
        frame True {
          case (w7) {
            frame Error {
              w8 = w7
            }
            frame No Error {
              Wait On Occurrence(ignore previous=FALSE, occurrence=w4)
              w8 = default
            }
          }
        }
      }
      Merge Errors($"error in", w8) -> (error out=w1)
    }
  }
  $"error out" <- w1
