vi "Configure Proxy Server.gvi"   [LabVIEW Platform Developer Preview 0.1.0]
inputs:
  "client handle": "Client Handle.gtype", required
  "proxy": string, required
  "proxy username": string
  "proxy password": string
  "proxy port": u16
  "error in": error
outputs:
  "error out": error
  "client handle out": "Client Handle.gtype"
types:
  "Client Handle.gtype" = u32
uses:
  NI::G Core::HTTP::httpClient.sli::http_SetProxy
  NI::G Core::Error::Build Error Cluster.gvi
diagram:
  # Configures the session to use the
  # specified proxy server.
  case ($"error in") {
    frame Error {
      w1 = $"error in"
      w2 = $"client handle"
    }
    frame No Error {
      disable {
        frame TARGET_TYPE == "WebServer" {
          Property Node(instance in=$"error in", "status"=TRUE, "code"=1072, "source"="Configure Proxy Server.gvi") -> (instance out=w1)
          w2 = $"client handle"
        }
        frame 1, Default {
          call "http_SetProxy"(handle in=$"client handle", proxy=$proxy, proxyUser=$"proxy username", proxyPW=$"proxy password", proxyPort=$"proxy port", error in=$"error in") -> (return=w3, handle out=w2, error out=w4)
          call "Build Error Cluster.gvi"(code=w3, error in=w4) -> (error out=w1)
        }
      }
    }
  }
  $"client handle out" <- w2
  $"error out" <- w1
