vi "Configure SSL.gvi"   [LabVIEW Platform Developer Preview 0.1.0]
# Provides Secure Sockets Layer (SSL) authentication for Web requests associated with the client handle. Use SSL authentication with other HTTP Client VIs to send Web requests to a server, Web page, or Web service using SSL.
inputs:
  "client handle": "Client Handle.gtype", required  # client handle specifies the client handle to associate with the Web request. Use client handles to wire together multiple HTTP Client VIs while preserving authentication credentials, HTTP headers, and cookies. Client handles are not required when making independent Web requests without persistent data such as headers or credentials.
  "CA certificate file": path  # CA certificate file specifies the path to a list of trusted certificate authority (CA) certificates. If you specify TRUE for the verify server control, the client verifies the server's identity against this list of trusted certificates.
  "client certificate file": path
  "private key file": path  # private key file specifies the path to a private key file that is part of the client certificate and client authentication process.
  "error in": error
  "private key password": string  # private key password specifies a password for the private key file. If the private key file is not encrypted, you do not have to specify a private key password.
  "verify server": bool = TRUE  # verify server specifies whether to check the server's certificate against the list of trusted CA certificates specified by the CA certificate file control.
outputs:
  "client handle out": "Client Handle.gtype"  # client handle out returns the client handle associated with the Web request. Use client handles to wire together multiple HTTP Client VIs while preserving authentication credentials, HTTP headers, and cookies. Client handles are not required when making independent Web requests without persistent data such as headers or credentials.
  "error out": error
types:
  "Client Handle.gtype" = u32
uses:
  NI::G Core::HTTP::Smart Path To String.gvi
  NI::G Core::HTTP::httpClient.sli::http_SSLConfig
  NI::G Core::Error::Build Error Cluster.gvi
diagram:
  # Configures the SSL connection data for the current request chain.
  case ($"error in") {
    frame No Error {
      disable {
        frame TARGET_TYPE == "WebServer" {
          Property Node(instance in=$"error in", "status"=TRUE, "code"=1072, "source"="Configure SSL.gvi") -> (instance out=w1)
          w2 = $"client handle"
        }
        frame 1, Default {
          call "Smart Path To String.gvi"(output file=$"CA certificate file") -> (string=w3)
          call "Smart Path To String.gvi"(output file=$"private key file") -> (string=w4)
          call "Smart Path To String.gvi"(output file=$"client certificate file") -> (string=w5)
          Boolean To Integer(Boolean=$"verify server") -> (0, 1=w6)
          call "http_SSLConfig"(handle in=$"client handle", doServerCheck in=w6, CACertFile=w3, privateKeyFile=w4, pkPasswd=$"private key password", clientCertFile=w5, error in=$"error in") -> (return=w7, handle out=w2, error out=w8)
          call "Build Error Cluster.gvi"(code=w7, error in=w8) -> (error out=w1)
        }
      }
    }
    frame Error {
      w1 = $"error in"
      w2 = $"client handle"
    }
  }
  $"client handle out" <- w2
  $"error out" <- w1
