vi "Get Header.gvi"   [LabVIEW Platform Developer Preview 0.1.0]
# Returns the value assigned to the header  of the client handle. Headers define attributes of the data exchanged between the client and server. Client handles save header values across multiple Web requests. Use the Open Handle VI to create a client handle. Refer to the World Wide Web Consortium website at www.w3.org for more information about header field definitions including example headers, descriptions, and syntax.
inputs:
  "header": "Headers.gtype" = "User-Agent", required
  "client handle": "Client Handle.gtype", required  # client handle specifies the client handle to associate with the Web request. Use client handles to wire together multiple HTTP Client VIs while preserving authentication credentials, HTTP headers, and cookies. Client handles are not required when making independent Web requests without persistent data such as headers or credentials.
  "error in": error
outputs:
  "client handle out": "Client Handle.gtype"  # client handle out returns the client handle associated with the Web request. Use client handles to wire together multiple HTTP Client VIs while preserving authentication credentials, HTTP headers, and cookies. Client handles are not required when making independent Web requests without persistent data such as headers or credentials.
  "value": string  # value returns the value assigned to the header.
  "error out": error
types:
  "Client Handle.gtype" = u32
  "Headers.gtype" = string
uses:
  NI::G Core::HTTP::httpWebServerClient.sli::httpWebServer_GetHeader
  NI::G Core::HTTP::httpClient.sli::http_GetHeader
  NI::G Core::Error::Build Error Cluster.gvi
diagram:
  # Returns the value for a specified header with the
  # current request chain, if it exists.
  case ($"error in") {
    frame No Error {
      disable {
        frame TARGET_TYPE == "WebServer" {
          call "httpWebServer_GetHeader"(handle in=$"client handle", headerName in=$header, headerValue in="", error in=$"error in") -> (handle out=w1, headerValue out=w3, error out=w2)
        }
        frame 1, Default {
          call "http_GetHeader"(handle in=$"client handle", headerName=$header, headerValue in="", error in=$"error in") -> (return=w4, handle out=w1, headerValue out=w3, error out=w5)
          call "Build Error Cluster.gvi"(code=w4, error in=w5) -> (error out=w2)
        }
      }
    }
    frame Error {
      w1 = $"client handle"
      w2 = $"error in"
      w3 = default
    }
  }
  $value <- w3
  $"client handle out" <- w1
  $"error out" <- w2
