vi "HEAD.gvi"   [LabVIEW Platform Developer Preview 0.1.0]
# Sends a Web request that returns headers from a server, Web page, or Web service. This VI uses the HEAD HTTP method. This VI does not submit any data to the server or receive body data. The minimal data exchange makes the HEAD VI useful for testing the validity of a URL.
inputs:
  "client handle": "Client Handle.gtype"  # client handle specifies the client handle to associate with the Web request. Use client handles to wire together multiple HTTP Client VIs while preserving authentication credentials, HTTP headers, and cookies. Client handles are not required when making independent Web requests without persistent data such as headers or credentials.
  "url": string, required  # URL specifies the URL of the server, Web page, or Web service which this VI sends the Web request.
  "error in": error
  "timeout": i32 = 10000  # timeout specifies the amount of time in milliseconds to wait for a response from the server before the Web request times out. The default value is 10000 ms. A value of -1 defers timeout monitoring to the operating system.
outputs:
  "status code": u32
  "client handle out": "Client Handle.gtype"  # client handle out returns the client handle associated with the Web request. Use client handles to wire together multiple HTTP Client VIs while preserving authentication credentials, HTTP headers, and cookies. Client handles are not required when making independent Web requests without persistent data such as headers or credentials.
  "headers": string  # headers returns the header fields returned by the server. Refer to the World Wide Web Consortium website at www.w3.org for more information about header field definitions including available headers, descriptions, and syntax.
  "error out": error
types:
  "Client Handle.gtype" = u32
uses:
  NI::G Core::HTTP::httpWebServerClient.sli::httpWebServer_Head
  NI::G Core::HTTP::httpClient.sli::http_Head
  NI::G Core::Error::Build Error Cluster.gvi
  NI::G Core::HTTP::httpClient.sli::http_GetResult
  NI::G Core::HTTP::AutoCloseSession.gvi
diagram:
  # Requests that the server return the header
  # information from the supplied URL as if a GET had been called.
  disable {
    frame TARGET_TYPE == "WebServer" {
      call "httpWebServer_Head"(handle in=$"client handle", url in=$url, timeout in=$timeout, error in=$"error in") -> (handle out=w1, headers out=w2, statusCode out=w4, error out=w3)
    }
    frame 1, Default {
      Generate Occurrence() -> (occurrence=w5)
      case ($"error in") {
        frame No Error {
          call "http_Head"(handle in=$"client handle", request in=0, completeOccurrence in=w5, url=$url, timeout=$timeout) -> (return=w10, handle out=w7, request out=w8, completeOccurrence out=w9)
          call "Build Error Cluster.gvi"(code=w10, error in=$"error in") -> (error out=w6)
        }
        frame Error {
          w6 = $"error in"
          w7 = $"client handle"
          w8 = default
          w9 = w5
        }
      }
      case (w6) {
        frame No Error, Default {
          sequence {
            frame 0 {
              Wait On Occurrence(ignore previous=FALSE, occurrence=w9)
            }
          }
          call "http_GetResult"(handle in=w7, request=w8, returnHeader in="", returnBody in="", httpStatus in=0, error in=w6) -> (return=w11, handle out=w1, returnHeader out=w2, httpStatus out=w4, error out=w12)
          call "Build Error Cluster.gvi"(code=w11, error in=w12) -> (error out=w3)
        }
        frame Error {
          w3 = w6
          w1 = w7
          w2 = default
          w4 = default
        }
      }
      call "AutoCloseSession.gvi"(User supplied handle=$"client handle", Auto-generated handle=w1)
    }
  }
  $"client handle out" <- w1
  $headers <- w2
  $"status code" <- w4
  $"error out" <- w3
