vi "Header Exists.gvi"   [LabVIEW Platform Developer Preview 0.1.0]
# Determines if the header is associated with the client handle. Headers define attributes of the data exchanged between the client and server. Client handles save header values across multiple Web requests. Use the Open Handle VI to create a client handle. Refer to the World Wide Web Consortium website at www.w3.org for more information about header field definitions including example headers, descriptions, and syntax.
inputs:
  "header": "Headers.gtype" = "User-Agent", required
  "client handle": "Client Handle.gtype", required  # client handle specifies the client handle to associate with the Web request. Use client handles to wire together multiple HTTP Client VIs while preserving authentication credentials, HTTP headers, and cookies. Client handles are not required when making independent Web requests without persistent data such as headers or credentials.
  "error in": error
outputs:
  "client handle out": "Client Handle.gtype"  # client handle out returns the client handle associated with the Web request. Use client handles to wire together multiple HTTP Client VIs while preserving authentication credentials, HTTP headers, and cookies. Client handles are not required when making independent Web requests without persistent data such as headers or credentials.
  "header exists?": bool  # header exists? returns TRUE if the specified header is associated with the client handle.
  "value": string  # value returns the value assigned to the header. If header exists? returns FALSE, this output returns an empty string.
  "error out": error
types:
  "Client Handle.gtype" = u32
  "Headers.gtype" = string
uses:
  NI::G Core::HTTP::httpWebServerClient.sli::httpWebServer_HeaderExists
  NI::G Core::HTTP::httpClient.sli::http_HeaderExists
  NI::G Core::Error::Build Error Cluster.gvi
diagram:
  # Checks to see if a specific header exists
  # within the current request chain.
  case ($"error in") {
    frame No Error {
      disable {
        frame TARGET_TYPE == "WebServer" {
          call "httpWebServer_HeaderExists"(handle in=$"client handle", headerName in=$header, headerExists in=0, headerValue in="", error in=$"error in") -> (handle out=w1, headerExists out=w5, headerValue out=w3, error out=w2)
          Is Not Equal To 0(x=w5) -> w4
        }
        frame 1, Default {
          call "http_HeaderExists"(handle in=$"client handle", headerName=$header, headerExists in=0, headerValue in="", error in=$"error in") -> (return=w6, handle out=w1, headerExists out=w7, headerValue out=w3, error out=w8)
          Is Not Equal To 0(x=w7) -> w4
          call "Build Error Cluster.gvi"(code=w6, error in=w8) -> (error out=w2)
        }
      }
    }
    frame Error {
      w1 = $"client handle"
      w2 = $"error in"
      w3 = default
      w4 = default
    }
  }
  $"header exists?" <- w4
  $"client handle out" <- w1
  $value <- w3
  $"error out" <- w2
