vi "Open HTTP Handle.gvi"   [LabVIEW Platform Developer Preview 0.1.0]
# Opens a client handle. Use client handles to wire together multiple HTTP Client VIs while preserving authentication credentials, HTTP headers, and cookies. You can specify a username and password, if necessary, to send Web requests to a server that requires authentication. You also can create a cookie file that stores data across multiple Web requests.
inputs:
  "cookie file": path  # cookie file is the path to store a client-side cookie. Cookies store data across multiple Web requests.
  "username": string  # username specifies the log-in username for the SMTP server you specify. On most public servers, this is your email address.
  "password": string  # password specifies the log-in password for the SMTP server you specify.
  "error in": error
  "verify server": bool = TRUE  # verify server (true) specifies whether to verify the server's identity and establish a secure connection. Use this control to allow HTTP Client VIs to communicate using the https:// protocol. The default value is TRUE.
outputs:
  "client handle out": "Client Handle.gtype"  # client handle out returns the client handle associated with the Web request. Use client handles to wire together multiple HTTP Client VIs while preserving authentication credentials, HTTP headers, and cookies. Client handles are not required when making independent Web requests without persistent data such as headers or credentials.
  "error out": error
types:
  "Client Handle.gtype" = u32
uses:
  NI::G Core::HTTP::httpWebServerClient.sli::httpWebServer_Open
  NI::G Core::HTTP::Smart Path To String.gvi
  NI::G Core::HTTP::httpClient.sli::http_Open
  NI::G Core::Error::Build Error Cluster.gvi
diagram:
  # Creates a reference ID to be used for a series
  # of HTTP requests.
  case ($"error in") {
    frame No Error {
      Boolean To Integer(Boolean=$"verify server") -> (0, 1=w3)
      disable {
        frame TARGET_TYPE == "WebServer" {
          call "httpWebServer_Open"(cookieFile in="", username in=$username, password in=$password, verifyServer in=w3, handle in=0, error in=$"error in") -> (handle out=w1, error out=w2)
        }
        frame 1, Default {
          call "Smart Path To String.gvi"(output file=$"cookie file") -> (string=w4)
          call "http_Open"(handle in=0, cookieFile=w4, username=$username, password=$password, verifyServer=w3) -> (return=w5, handle out=w1)
          call "Build Error Cluster.gvi"(code=w5, error in=$"error in") -> (error out=w2)
        }
      }
    }
    frame Error {
      w1 = default
      w2 = $"error in"
    }
  }
  $"client handle out" <- w1
  $"error out" <- w2
