vi "POST Buffer.gvi"   [LabVIEW Platform Developer Preview 0.1.0]
# Sends a Web request that submits data or a file to a server, Web page, or Web service. This VI uses the POST HTTP method.  Refer to the World Wide Web Consortium website at www.w3.org for more information about HTTP method definitions, including the POST method. Use the POSTMultipart VI to send POST requests using the multipart/form-data MIME type.
inputs:
  "client handle": "Client Handle.gtype"  # client handle specifies the client handle to associate with the Web request. Use client handles to wire together multiple HTTP Client VIs while preserving authentication credentials, HTTP headers, and cookies. Client handles are not required when making independent Web requests without persistent data such as headers or credentials.
  "url": string, required  # URL specifies the URL of the server, Web page, or Web service which this VI sends the Web request.
  "buffer": string  # buffer specifies a string of data to send to the server.
  "error in": error
  "output file": path  # output file specifies a file to save body data returned by the server. If you do not specify an output file, the VI does not save the body data to a file.
  "timeout": i32 = 10000  # timeout specifies the amount of time in milliseconds to wait for a response from the server before the Web request times out. The default value is 10000 ms. A value of -1 defers timeout monitoring to the operating system.
outputs:
  "status code": u32
  "client handle out": "Client Handle.gtype"  # client handle out returns the client handle associated with the Web request. Use client handles to wire together multiple HTTP Client VIs while preserving authentication credentials, HTTP headers, and cookies. Client handles are not required when making independent Web requests without persistent data such as headers or credentials.
  "headers": string  # headers returns the header fields returned by the server. Refer to the World Wide Web Consortium website at www.w3.org for more information about header field definitions including available headers, descriptions, and syntax.
  "body": string  # body returns body data returned by the server.
  "error out": error
types:
  "Client Handle.gtype" = u32
uses:
  NI::G Core::HTTP::httpWebServerClient.sli::httpWebServer_Post
  NI::G Core::HTTP::Smart Path To String.gvi
  NI::G Core::HTTP::httpClient.sli::http_Post
  NI::G Core::Error::Build Error Cluster.gvi
  NI::G Core::HTTP::httpClient.sli::http_GetResult
  NI::G Core::HTTP::AutoCloseSession.gvi
diagram:
  # Requests that the server accept the data as a new subordinate
  # of the resource identified by the URL.
  disable {
    frame TARGET_TYPE == "WebServer" {
      call "httpWebServer_Post"(handle in=$"client handle", url in=$url, outputPath in="", buffer in=$buffer, timeout in=$timeout, error in=$"error in") -> (handle out=w1, headers out=w2, body out=w3, statusCode out=w5, error out=w4)
    }
    frame 1, Default {
      Generate Occurrence() -> (occurrence=w6)
      case ($"error in") {
        frame No Error {
          call "Smart Path To String.gvi"(output file=$"output file") -> (string=w11)
          call "http_Post"(handle in=$"client handle", request in=0, completeOccurrence in=w6, url=$url, outPath=w11, timeout=$timeout, postData=$buffer, error in=$"error in") -> (return=w12, handle out=w7, request out=w9, completeOccurrence out=w10, error out=w13)
          call "Build Error Cluster.gvi"(code=w12, error in=w13) -> (error out=w8)
        }
        frame Error {
          w7 = $"client handle"
          w8 = default
          w9 = default
          w10 = w6
        }
      }
      case (w8) {
        frame No Error, Default {
          sequence {
            frame 0 {
              Wait On Occurrence(ignore previous=FALSE, occurrence=w10)
            }
          }
          call "http_GetResult"(handle in=w7, request=w9, returnHeader in="", returnBody in="", httpStatus in=0, error in=w8) -> (return=w14, handle out=w1, returnHeader out=w2, returnBody out=w3, httpStatus out=w5, error out=w15)
          call "Build Error Cluster.gvi"(code=w14, error in=w15) -> (error out=w4)
        }
        frame Error {
          w1 = w7
          w2 = default
          w3 = default
          w4 = w8
          w5 = default
        }
      }
      call "AutoCloseSession.gvi"(User supplied handle=$"client handle", Auto-generated handle=w1)
    }
  }
  $"client handle out" <- w1
  $headers <- w2
  $body <- w3
  $"status code" <- w5
  $"error out" <- w4
