vi "Parse Headers.gvi"   [LabVIEW Platform Developer Preview 0.1.0]
inputs:
  "headers in": string, required
  "error in": error
outputs:
  "status": u8
  "headers out": variant
  "error out": error
diagram:
  # Parses the headers to output the HTTP status code.
  case ($"error in") {
    frame No Error {
      s1 = variant()  # shift register
      while (iteration -> i1) {
        Increment(x=i1) -> w5
        Pick Line(line index=w5, multi-line string=$"headers in") -> (output string=w6)
        Search Or Split String(search string/char=":", string=w6) -> (match + rest of string=w7, offset of match=w8, substring before match=w9)
        Is Less Than 0(x=w8) -> w10
        case (w10) {
          frame False, Default {
            # Skip ": "
            String Subset(offset (0)=2, string=w7) -> w13
            Set Variant Attribute(name=w9, value=w13, variant=s1) -> (error out=w12, variant out=w11)
          }
          frame True {
            w11 = s1
            w12 = default
          }
        }
        append w12 to w4
        next s1 = w11
        stop if w10
      }
      Scan From String(formatString="%3d", inputString=$"headers in", startLoc=9, errIn=$"error in") -> (errOut=w14, out0=w3)
      Merge Errors(w14, w4) -> (error out=w2)
      w1 = s1
    }
    frame Error {
      w1 = default
      w2 = $"error in"
      w3 = default
    }
  }
  $"headers out" <- w1
  $"error out" <- w2
  $status <- w3
