vi "Remove Header.gvi"   [LabVIEW Platform Developer Preview 0.1.0]
# Removes a header field line from all Web requests associated with the client handle. Headers define attributes of the data exchanged between the client and server. Client handles save header values across multiple Web requests. Use the Open Handle VI to create a client handle. Refer to the World Wide Web Consortium website at www.w3.org for more information about header field definitions including example headers, descriptions, and syntax.
inputs:
  "header": "Headers.gtype" = "User-Agent", required
  "client handle": "Client Handle.gtype", required  # client handle specifies the client handle to associate with the Web request. Use client handles to wire together multiple HTTP Client VIs while preserving authentication credentials, HTTP headers, and cookies. Client handles are not required when making independent Web requests without persistent data such as headers or credentials.
  "error in": error
outputs:
  "client handle out": "Client Handle.gtype"  # client handle out returns the client handle associated with the Web request. Use client handles to wire together multiple HTTP Client VIs while preserving authentication credentials, HTTP headers, and cookies. Client handles are not required when making independent Web requests without persistent data such as headers or credentials.
  "error out": error
types:
  "Client Handle.gtype" = u32
  "Headers.gtype" = string
uses:
  NI::G Core::HTTP::httpWebServerClient.sli::httpWebServer_RemoveHeader
  NI::G Core::HTTP::httpClient.sli::http_RemoveHeader
  NI::G Core::Error::Build Error Cluster.gvi
diagram:
  # Removes a header from the collection
  # being used for the current request chain.
  case ($"error in") {
    frame No Error {
      disable {
        frame TARGET_TYPE == "WebServer" {
          call "httpWebServer_RemoveHeader"(handle in=$"client handle", headerName in=$header, error in=$"error in") -> (handle out=w1, error out=w2)
        }
        frame 1, Default {
          call "http_RemoveHeader"(handle in=$"client handle", headerName=$header, error in=$"error in") -> (return=w3, handle out=w1, error out=w4)
          call "Build Error Cluster.gvi"(code=w3, error in=w4) -> (error out=w2)
        }
      }
    }
    frame Error {
      w1 = $"client handle"
      w2 = $"error in"
    }
  }
  $"error out" <- w2
  $"client handle out" <- w1
