vi "Smart Path To String.gvi"   [LabVIEW Platform Developer Preview 0.1.0]
inputs:
  "output file": path, required
outputs:
  "string": string
diagram:
  # Converts a path to string replacing
  # invalid or empty paths with the empty string.
  Is Empty String Or Path(string/path=$"output file") -> w1
  Is Not A Number Or Path Or Refnum(number=$"output file") -> w2
  Logical Or(w1, w2) -> w3
  Path To String(path=$"output file") -> (string=w4)
  Select(s=w3, t="", f=w4) -> w5
  $string <- w5
