vi "Read Tag Waveform.gviweb"   [LabVIEW Platform Developer Preview 0.1.0]
inputs:
  "Server": string
  "Tag": string
outputs:
  "values": f64[]
  "Timestamp": string
types:
  T1 = cluster{"Timestamp": string, "Value": cluster{"Value": string, "Type": string}}
  T2 = cluster{"Aggregates": string, "Path": string, "Current": T1}
diagram:
  Concatenate Strings("http://", $Server, "/nitag/tag/", $Tag, "/values") -> w1
  call "WebVI_Get.gvi"(Url In=w1, Client Handle In=0, Output File In="userName", Time Out In=0, Error Code In=0, Error Message In="") -> (Body Out=w2)
  Unflatten From JSON(JSON string=w2, type and defaults=T2 {all zero or empty}) -> (value=w3)
  Property Node(instance in=w3) -> ("Current:Value:Value"=w4, "Current:Timestamp"=w5)
  Unflatten From JSON(JSON string=w4, type and defaults=f64[] []) -> (value=w6)
  $values <- w6
  $Timestamp <- w5
