vi "Build Array.gviweb"   [LabVIEW Platform Developer Preview 0.1.0]
inputs:
  "Numeric": f64
  "Numeric_2": f64
  "Numeric_3": f64
  "Numeric_4": f64
outputs:
  "value": f64[][]
panel indicators:
  "output array": f64[]
  "JSON string": string
diagram:
  Replace Array Subset(inArray=[0, 0, 0, 0], index=0, new=$Numeric, index=_, new=$Numeric_2, index=_, new=$Numeric_3, index=_, new=$Numeric_4) -> w1
  Flatten To JSON(anything=w1) -> (JSON string=w2)
  $"JSON string" <- w2
  Concatenate Strings("[", w2, "]") -> w3
  Unflatten From JSON(JSON string=w3, type and defaults=f64[][] []) -> (value=w4)
  $value <- w4
  $"output array" <- w1
