vi "Function.gviweb"   [LabVIEW NXG 2.0.0]
panel controls:
  "Trigger Send": bool
  "Trigger Reset": bool
  "Channel": i32
panel indicators:
  "Send File": bool
  "Temp": T1
  "Buffer": f64
  "Files Sent": f64
  "Available Memory": f64
  "Available Disk": f64
  "Reset": bool
types:
  T1 = cluster{"Element 1": f64, "Element 2": f64, "Element 3": f64, "Element 4": f64}
uses:
  Application::Send Message.gviweb
  Application::Reset Aggregates.gviweb
  Application::Read Tag (Double).gviweb
diagram:
  case (FALSE) {
    frame False, Default {
      w1 = "jprewitt4"
      w2 = "josh-9068"
    }
    frame True {
      w3 = "ni-crio-9068-190cb7b"  # Target
      w4 = "54.82.138.142"  # Server
      w1 = w4
      w2 = w3
    }
  }
  while {
    Wait(time to wait=50)
    case ($"Trigger Send") {
      frame False, Default {
        $"Send File" <- FALSE
      }
      frame True {
        Wait(time to wait=500)
        $"Send File" <- TRUE
        call "Send Message.gviweb"(Topic="send_file", Server=w1, Message="send_file")
      }
    }
    case ($"Trigger Reset") {
      frame False, Default {
        $Reset <- FALSE
      }
      frame True {
        $Reset <- TRUE
        Format Value(format string="%d", value=$Channel) -> (output string=w5)
        Concatenate Strings(w2, ".ai.", w5) -> w6
        call "Reset Aggregates.gviweb"(Server=w1, Tag=w6)
        Wait(time to wait=500)
      }
    }
    stop if FALSE
  }
  while {
    Wait(time to wait=1000)
    w7 = ["available_disk", "available_memory", "files_sent", "buffer", "ai"]
    for (iteration -> i1) {
      w8 = each element of w7
      Concatenate Strings(w2, ".", w8) -> w9
      case (i1) {
        frame 0, Default {
          call "Read Tag (Double).gviweb"(Server=w1, Tag=w9) -> (Value=w10)
          $"Available Disk" <- w10
        }
        frame 1 {
          call "Read Tag (Double).gviweb"(Server=w1, Tag=w9) -> (Value=w11)
          $"Available Memory" <- w11
        }
        frame 2 {
          call "Read Tag (Double).gviweb"(Server=w1, Tag=w9) -> (Value=w12)
          $"Files Sent" <- w12
        }
        frame 3 {
          call "Read Tag (Double).gviweb"(Server=w1, Tag=w9) -> (Value=w13)
          $Buffer <- w13
        }
        frame 4 {
          Format Value(format string="%d", value=$Channel) -> (output string=w14)
          Concatenate Strings(w9, ".", w14) -> w15
          call "Read Tag (Double).gviweb"(Server=w1, Tag=w15) -> (Value=w16, Minimum=w17, Average=w18, Maximum=w19)
          Build Cluster(w16, w17, w18, w19) -> w20
          $Temp <- w20
        }
      }
    }
    stop if FALSE
  }
