vi "Read Tag (Double).gviweb"   [LabVIEW Platform Developer Preview 0.1.0]
inputs:
  "Server": string
  "Tag": string
outputs:
  "Value": f64
  "Minimum": f64
  "Average": f64
  "Maximum": f64
  "Count": f64
  "Timestamp": string
types:
  T1 = cluster{"Timestamp": string, "Value": cluster{"Type": string, "Value": string}}
  T2 = cluster{"Sum": string, "Min": string, "Max": string, "Count": f64, "Avg": f64}
  T3 = cluster{"Path": string, "Current": T1, "Aggregates": T2}
uses:
  NI::HTTP::GET.gvi
diagram:
  Concatenate Strings("http://", $Server, "/nitag/tag/", $Tag, "/values") -> w1
  call "GET.gvi"(url=w1) -> (body=w2)
  Unflatten From JSON(JSON string=w2, default null elements=FALSE, enable LabVIEW extensions=TRUE, path=string[] [], strict validation=TRUE, type and defaults=T3 {all zero or empty}) -> (value=w3)
  Property Node(instance in=w3) -> ("Current:Value:Value"=w4, "Current:Timestamp"=w5, "Aggregates:Min"=w6, "Aggregates:Max"=w7, "Aggregates:Count"=w8, "Aggregates:Avg"=w9)
  Scan From String(formatString="%f", inputString=w4) -> (out0=w10)
  $Value <- w10
  $Timestamp <- w5
  Scan From String(formatString="%f", inputString=w6) -> (out0=w11)
  $Minimum <- w11
  Scan From String(formatString="%f", inputString=w7) -> (out0=w12)
  $Maximum <- w12
  $Count <- w8
  $Average <- w9
