vi "Read Tag (Int).gviweb"   [LabVIEW Platform Developer Preview 0.1.0]
inputs:
  "Server": string
  "Tag": string
outputs:
  "Value": i32
  "Timestamp": string
  "Count": f64
  "Average": f64
  "Minimum": string
  "Maximum": string
panel indicators:
  "URI": string
  "Response": string
types:
  T1 = cluster{"Timestamp": string, "Value": cluster{"Type": string, "Value": string}}
  T2 = cluster{"Sum": string, "Min": string, "Max": string, "Count": f64, "Avg": f64}
  T3 = cluster{"Path": string, "Current": T1, "Aggregates": T2}
uses:
  NI::HTTP::GET.gvi
diagram:
  Concatenate Strings("http://", $Server, "/nitag/tag/", $Tag, "/values") -> w1
  call "GET.gvi"(url=w1) -> (body=w2)
  $Response <- w2
  w3 = T3 {all zero or empty}  # Cluster Constant
  Unflatten From JSON(JSON string=w2, default null elements=FALSE, enable LabVIEW extensions=TRUE, path=string[] [], strict validation=TRUE, type and defaults=w3) -> (value=w4)
  Property Node(instance in=w4) -> ("Current:Value:Value"=w5, "Current:Timestamp"=w6, "Aggregates:Min"=w7, "Aggregates:Max"=w8, "Aggregates:Count"=w9, "Aggregates:Avg"=w10)
  Scan From String(formatString="%d", inputString=w5) -> (out0=w11)
  $Value <- w11
  $Timestamp <- w6
  $Minimum <- w7
  $Maximum <- w8
  $Count <- w9
  $Average <- w10
  $URI <- w1
