vi "Reset Aggregates.gviweb"   [LabVIEW NXG 2.0.0]
inputs:
  "Server": string
  "Tag": string
panel indicators:
  "url": string
uses:
  NI::HTTP::POST Buffer.gvi
diagram:
  Concatenate Strings("http://", $Server, "/nitag/v1/tags/", $Tag, "/reset-aggregates") -> w1
  call "POST Buffer.gvi"(url=w1)
  $url <- w1
