vi "Send Message.gviweb"   [LabVIEW Platform Developer Preview 0.1.0]
inputs:
  "Topic": string
  "Server": string = "jprewitt4"
  "Message": string
panel indicators:
  "body": string
  "body_2": string
  "body_3": string
  "publish message url": string
  "concatenated string_2": string
  "publish body": string
uses:
  NI::HTTP::POST Buffer.gvi
  NI::HTTP::DELETE.gvi
diagram:
  Concatenate Strings("http://", $Server, "/nimessage/sessions/") -> w1
  call "POST Buffer.gvi"(url=w1) -> (client handle out=w2, body=w3, error out=w4)
  Unflatten From JSON(JSON string=w3, type and defaults=cluster{"Token": string} {all zero or empty}) -> (value=w5)
  Property Node(instance in=w5) -> ("Token"=w6)
  Concatenate Strings(w1, w6, "/messages") -> w7
  $"publish message url" <- w7
  Concatenate Strings(w1, w6) -> w8
  w9 = cluster{"Topic": string, "Message": string} {all zero or empty}
  Property Node(instance in=w9, "Topic"=$Topic, "Message"=$Message) -> (instance out=w10)
  Flatten To JSON(anything=w10) -> (JSON string=w11)
  call "POST Buffer.gvi"(client handle=w2, url=w7, buffer=w11, error in=w4) -> (client handle out=w12, body=w13, error out=w14)
  call "DELETE.gvi"(client handle=w12, url=w8, error in=w14) -> (body=w15)
  $body_3 <- w15
  $body_2 <- w13
  $body <- w3
  $"publish body" <- w11
  $"concatenated string_2" <- w8
